# Dynamo graph SetViewportCustomScaleName_Up.dyn "SetViewportScaleUp" (Dynamo 2.19.3.6394)

element_classes = ElementTypes("Viewport")
all_elements_of_class = ElementsOfType(element_class=element_classes)
string = StringInput("View Scale")
getParameterValueByName = Element.GetParameterValueByName(element=all_elements_of_class, parameterName=string)
isInteger = Python(IN[0]=getParameterValueByName)  # CPython3
# ---------- isInteger.python (20 lines) ----------
# Load the Python Standard and DesignScript Libraries
import sys
import clr
clr.AddReference('ProtoGeometry')
from Autodesk.DesignScript.Geometry import *

# The inputs to this node will be stored as a list in the IN variables.
scaleList = IN[0]

# Place your code below this line
output = []

for l in scaleList:
    if type(l) == str:
        output.append(False)
    else:
        output.append(True)

# Assign your output to the OUT variable.
OUT = output
# ----------------------------------------
filterByBoolMask = List.FilterByBoolMask(list=all_elements_of_class, mask=isInteger)
string_2 = StringInput("1:")
filterByBoolMask_2 = List.FilterByBoolMask(list=getParameterValueByName, mask=isInteger)
python_script = Python(IN[0]=filterByBoolMask_2.in)  # CPython3
# ---------- python_script.python (19 lines) ----------
# Load the Python Standard and DesignScript Libraries
import sys
import clr
clr.AddReference('ProtoGeometry')
from Autodesk.DesignScript.Geometry import *

# The inputs to this node will be stored as a list in the IN variables.
numberList = IN[0]

# Import math module for floor function
import math

number = []
# Place your code below this line
for n in numberList:
    number.append(math.floor(n/2))

# Assign your output to the OUT variable.
OUT = number
# ----------------------------------------
add = string_2 + python_script
setViewportCustomScaleName = Python(viewportList_0=filterByBoolMask.in, overrideValue_1=add)  # CPython3
# ---------- setViewportCustomScaleName.python (37 lines) ----------
# Load the Python Standard and DesignScript Libraries
import sys
import clr
clr.AddReference('ProtoGeometry')
from Autodesk.DesignScript.Geometry import *

# The inputs to this node will be stored as a list in the IN variables.
dataEnteringNode = IN

# Place your code below this line

clr.AddReference('RevitAPI')
from Autodesk.Revit.DB import *

clr.AddReference('RevitServices')
import RevitServices
from RevitServices.Persistence import DocumentManager
from RevitServices.Transactions import TransactionManager

doc = DocumentManager.Instance.CurrentDBDocument
uidoc = DocumentManager.Instance.CurrentUIApplication.ActiveUIDocument

viewports = UnwrapElement(IN[0])
override = IN[1]

TransactionManager.Instance.EnsureInTransaction(doc)
params = []
for v, d in zip(viewports, override):
    pa = v.get_Parameter(BuiltInParameter.VIEW_SCALE_CUSTOMNAME)
    v.get_Parameter(BuiltInParameter.VIEW_SCALE_HAVENAME).Set(1)
    pa.Set(d)
    params.append(pa)
	
TransactionManager.Instance.TransactionTaskDone()

# Assign your output to the OUT variable.
OUT = viewports
# ----------------------------------------
